% Simulink data dictionary PMSM_FOC_Data.sldd

FOC_Native_CurrentIntegratorLimit = Simulink.Parameter(single(30), StorageClass="ExportedGlobal", Min=0, Max=100, Unit="A")  % D/q PI integrator absolute limit Owner=Control; Version=2.1.0; Class=TunableCalibration.
FOC_Native_CurrentPeriod = Simulink.Parameter(single(0.0001), Min=1.0e-6, Max=0.01, Unit="s")  % Current-control task period Owner=Scheduler; Version=2.1.0; Class=CompileTimeConstant.
FOC_Native_DutyMax = Simulink.Parameter(single(0.98), StorageClass="ExportedGlobal", Min=0, Max=1, Unit="1")  % Maximum SVPWM duty Owner=Modulation; Version=2.1.0; Class=TunableCalibration.
FOC_Native_DutyMin = Simulink.Parameter(single(0.02), StorageClass="ExportedGlobal", Min=0, Max=1, Unit="1")  % Minimum SVPWM duty Owner=Modulation; Version=2.1.0; Class=TunableCalibration.
FOC_Native_FluxPM = Simulink.Parameter(single(0.05), StorageClass="ExportedGlobal", Min=0, Max=1, Unit="Wb")  % Permanent-magnet flux linkage Owner=MotorCalibration; Version=2.1.0; Class=TunableCalibration.
FOC_Native_IqLimit = Simulink.Parameter(single(8), StorageClass="ExportedGlobal", Min=0, Max=40, Unit="A")  % Speed-loop q-axis current command limit Owner=Control; Version=2.1.0; Class=TunableCalibration.
FOC_Native_KiCurrent = Simulink.Parameter(single(500), StorageClass="ExportedGlobal", Min=0, Max=100000, Unit="V/(A*s)")  % Current PI integral gain Owner=Control; Version=2.1.0; Class=TunableCalibration.
FOC_Native_KiSpeed = Simulink.Parameter(single(0.05), StorageClass="ExportedGlobal", Min=0, Max=100, Unit="A/(rad)")  % Speed PI integral gain Owner=Control; Version=2.1.0; Class=TunableCalibration.
FOC_Native_KpCurrent = Simulink.Parameter(single(1), StorageClass="ExportedGlobal", Min=0, Max=1000, Unit="V/A")  % Current PI proportional gain Owner=Control; Version=2.1.0; Class=TunableCalibration.
FOC_Native_KpSpeed = Simulink.Parameter(single(0.02), StorageClass="ExportedGlobal", Min=0, Max=100, Unit="A/(rad/s)")  % Speed PI proportional gain Owner=Control; Version=2.1.0; Class=TunableCalibration.
FOC_Native_Ld = Simulink.Parameter(single(0.001), StorageClass="ExportedGlobal", Min=1.0e-6, Max=1, Unit="H")  % D-axis inductance Owner=MotorCalibration; Version=2.1.0; Class=TunableCalibration.
FOC_Native_Lq = Simulink.Parameter(single(0.001), StorageClass="ExportedGlobal", Min=1.0e-6, Max=1, Unit="H")  % Q-axis inductance Owner=MotorCalibration; Version=2.1.0; Class=TunableCalibration.
FOC_Native_PolePairs = Simulink.Parameter(single(4), StorageClass="ExportedGlobal", Min=1, Max=64, Unit="1")  % Integer-valued motor pole-pair count stored as single for plant equation compatibility Owner=MotorCalibration; Version=2.1.0; Class=TunableCalibration.
FOC_Native_SpeedPeriod = Simulink.Parameter(single(0.001), Min=1.0e-5, Max=0.1, Unit="s")  % Speed-control task period Owner=Scheduler; Version=2.1.0; Class=CompileTimeConstant.
FOC_Native_VoltageLimit = Simulink.Parameter(single(26), StorageClass="ExportedGlobal", Min=0, Max=1000, Unit="V")  % Independent d/q voltage command limit Owner=Control; Version=2.1.0; Class=TunableCalibration.
NATIVE_INV_SQRT3 = Simulink.Parameter(single(0.577350259), Min=0, Max=1, Unit="1")  % Inverse square root of three Owner=MathLibrary; Version=2.1.0; Class=CompileTimeConstant.
NATIVE_RPM_TO_RAD_S = Simulink.Parameter(single(0.104719758), Min=0, Max=1, Unit="rad/s/rpm")  % RPM to radians-per-second conversion Owner=MathLibrary; Version=2.1.0; Class=CompileTimeConstant.
NATIVE_SQRT3_BY2 = Simulink.Parameter(single(0.866025388), Min=0, Max=1, Unit="1")  % Square root of three divided by two Owner=MathLibrary; Version=2.1.0; Class=CompileTimeConstant.
PMSM_Protection_MaxCurrent_A = Simulink.Parameter(single(12), StorageClass="ExportedGlobal", Min=0, Max=40, Unit="A")  % Fast overcurrent trip threshold Owner=Safety; Version=2.1.0; Class=TunableCalibration.
PMSM_Protection_MaxSpeed_Rpm = Simulink.Parameter(single(3000), StorageClass="ExportedGlobal", Min=0, Max=12000, Unit="rpm")  % Slow overspeed trip threshold Owner=Safety; Version=2.1.0; Class=TunableCalibration.
PMSM_Protection_MinDcBus_V = Simulink.Parameter(single(10), StorageClass="ExportedGlobal", Min=0, Max=1000, Unit="V")  % DC-bus undervoltage threshold Owner=Safety; Version=2.1.0; Class=TunableCalibration.
PMSM_Protection_MaxDcBus_V = Simulink.Parameter(single(60), StorageClass="ExportedGlobal", Min=0, Max=1000, Unit="V")  % DC-bus overvoltage threshold Owner=Safety; Version=2.1.0; Class=TunableCalibration.
PMSM_Calibration_SampleCount = Simulink.Parameter(uint16(100), StorageClass="ExportedGlobal", Min=1, Max=65535, Unit="1")  % Current-offset averaging sample count Owner=Measurement; Version=2.1.0; Class=TunableCalibration.
PMSM_Calibration_TimeoutTicks = Simulink.Parameter(uint16(15), StorageClass="ExportedGlobal", Min=1, Max=65535, Unit="1")  % Calibration timeout in 1 ms supervisor ticks Owner=StateManager; Version=2.1.0; Class=TunableCalibration.
PMSM_Alignment_Vd_V = Simulink.Parameter(single(2), StorageClass="ExportedGlobal", Min=-1000, Max=1000, Unit="V")  % Alignment d-axis voltage Owner=Control; Version=2.1.0; Class=TunableCalibration.
PMSM_Alignment_Vq_V = Simulink.Parameter(single(0), StorageClass="ExportedGlobal", Min=-1000, Max=1000, Unit="V")  % Alignment q-axis voltage Owner=Control; Version=2.1.0; Class=TunableCalibration.
PMSM_Alignment_Sin = Simulink.Parameter(single(0), Min=-1, Max=1, Unit="1")  % Alignment electrical-angle sine Owner=Control; Version=2.1.0; Class=CompileTimeConstant.
PMSM_Alignment_Cos = Simulink.Parameter(single(1), Min=-1, Max=1, Unit="1")  % Alignment electrical-angle cosine Owner=Control; Version=2.1.0; Class=CompileTimeConstant.
PMSM_Alignment_DurationTicks = Simulink.Parameter(uint16(20), StorageClass="ExportedGlobal", Min=1, Max=65535, Unit="1")  % Alignment duration in 1 ms supervisor ticks Owner=StateManager; Version=2.1.0; Class=TunableCalibration.
PMSM_SafeDuty = Simulink.Parameter(single(0.5), Min=0, Max=1, Unit="1")  % Duty applied while PWM is inhibited Owner=Safety; Version=2.1.0; Class=CompileTimeConstant.

ControlCommandBus = Simulink.Bus(DataScope="Exported")  % ControlCommandBus v2.1.0 interface contract
  StartRequest: boolean, Min=0, Max=1, Unit="1"  % Ts=1 ms; Class=RuntimeSignal; Level request sampled by the 1 ms command arbiter; hold for at least one slow tick
  StopRequest: boolean, Min=0, Max=1, Unit="1"  % Ts=1 ms; Class=RuntimeSignal; Stop level; has priority over StartRequest and must be asserted for at least one slow tick
  EmergencyStop: boolean, Min=0, Max=1, Unit="1"  % Ts=100 us; Class=RuntimeSignal; Fast emergency-stop level; directly latches fault bit 0 and inhibits PWM
  DriverFault: boolean, Min=0, Max=1, Unit="1"  % Ts=100 us; Class=RuntimeSignal; Fast gate-driver fault level; directly latches fault bit 1 and inhibits PWM
  HardwareGate: boolean, Min=0, Max=1, Unit="1"  % Ts=100 us; Class=RuntimeSignal; External hardware permission; false independently inhibits final PWM without software substitution
  Direction: int8, Min=-1, Max=1, Unit="1"  % Ts=1 ms; Class=RuntimeSignal; Requested direction: -1, 0 or +1
  SpeedReferenceRpm: single, Min=-6000, Max=6000, Unit="rpm"  % Ts=1 ms; Class=RuntimeSignal; Mechanical speed reference
  TorqueReferenceNm: single, Min=-20, Max=20, Unit="N*m"  % Ts=1 ms; Class=RuntimeSignal; Torque reference reserved for torque mode
  FaultResetRequest: boolean, Min=0, Max=1, Unit="1"  % Ts=1 ms; Class=RuntimeSignal; Reset level accepted only while stopped, start is clear, raw faults are clear, and HardwareGate is true

MeasurementBus = Simulink.Bus(DataScope="Exported")  % MeasurementBus v2.1.0 interface contract
  PhaseCurrentA: single, Min=-40, Max=40, Unit="A"  % Ts=100 us; Class=RuntimeSignal; Measured phase-A current
  PhaseCurrentB: single, Min=-40, Max=40, Unit="A"  % Ts=100 us; Class=RuntimeSignal; Measured phase-B current
  PhaseCurrentC: single, Min=-40, Max=40, Unit="A"  % Ts=100 us; Class=RuntimeSignal; Measured phase-C current; reserved for plausibility checks
  DcBusVoltage: single, Min=0, Max=1000, Unit="V"  % Ts=100 us; Class=RuntimeSignal; Measured DC-bus voltage
  ElectricalAngleRad: single, Min=-6.2831855, Max=6.2831855, Unit="rad"  % Ts=100 us; Class=RuntimeSignal; Electrical rotor angle
  MechanicalSpeedRpm: single, Min=-12000, Max=12000, Unit="rpm"  % Ts=1 ms; Class=RuntimeSignal; Mechanical rotor speed
  Valid: boolean, Min=0, Max=1, Unit="1"  % Ts=100 us; Class=RuntimeSignal; Aggregate measurement validity
  TimestampSeconds: single, Min=0, Max=1000000000, Unit="s"  % Ts=100 us; Class=RuntimeSignal; Acquisition timestamp
  FreshnessTicks: uint16, Min=0, Max=65535, Unit="1"  % Ts=100 us; Class=RuntimeSignal; Age since latest valid acquisition

ControlStatusBus = Simulink.Bus(DataScope="Exported")  % ControlStatusBus v2.1.0 interface contract
  DutyA: single, Min=0, Max=1, Unit="1"  % Ts=100 us; Class=ReadOnlyDiagnostic; Raw SVPWM phase-A duty request; actuator must also honor PwmEnable
  DutyB: single, Min=0, Max=1, Unit="1"  % Ts=100 us; Class=ReadOnlyDiagnostic; Raw SVPWM phase-B duty request; actuator must also honor PwmEnable
  DutyC: single, Min=0, Max=1, Unit="1"  % Ts=100 us; Class=ReadOnlyDiagnostic; Raw SVPWM phase-C duty request; actuator must also honor PwmEnable
  IqReference: single, Min=-40, Max=40, Unit="A"  % Ts=1 ms; Class=ReadOnlyDiagnostic; Q-axis current reference
  IdMeasured: single, Min=-40, Max=40, Unit="A"  % Ts=100 us; Class=ReadOnlyDiagnostic; Measured d-axis current
  IqMeasured: single, Min=-40, Max=40, Unit="A"  % Ts=100 us; Class=ReadOnlyDiagnostic; Measured q-axis current
  VdCommand: single, Min=-1000, Max=1000, Unit="V"  % Ts=100 us; Class=ReadOnlyDiagnostic; Applied d-axis voltage command
  VqCommand: single, Min=-1000, Max=1000, Unit="V"  % Ts=100 us; Class=ReadOnlyDiagnostic; Applied q-axis voltage command
  PwmEnable: boolean, Min=0, Max=1, Unit="1"  % Ts=100 us; Class=ReadOnlyDiagnostic; Single final permission: SupervisorPwmRequest AND FastInterlock AND HardwareGate
  MotorStateCode: uint8, Min=0, Max=255, Unit="1"  % Ts=1 ms; Class=ReadOnlyDiagnostic; Supervisor state code
  FaultBits: uint32, Min=0, Max=4294967295, Unit="1"  % Ts=100 us; Class=ReadOnlyDiagnostic; Latched fault bitmap: bits 0..6 = EStop, driver, overcurrent, invalid measurement, overspeed, undervoltage, overvoltage
  FaultCode: uint16, Min=0, Max=65535, Unit="1"  % Ts=100 us; Class=ReadOnlyDiagnostic; Primary latched fault code 1..7 in bitmap priority order; zero means no fault
  CurrentLimitActive: boolean, Min=0, Max=1, Unit="1"  % Ts=100 us; Class=ReadOnlyDiagnostic; Latched software-overcurrent status (fault bit 2)
  VoltageLimitActive: boolean, Min=0, Max=1, Unit="1"  % Ts=100 us; Class=ReadOnlyDiagnostic; Voltage saturation status; detailed detection belongs to CTL-001
  MeasurementValid: boolean, Min=0, Max=1, Unit="1"  % Ts=100 us; Class=ReadOnlyDiagnostic; Echo of aggregate measurement validity

CalibrationBus = Simulink.Bus(DataScope="Exported")  % CalibrationBus v2.1.0 interface contract
  PhaseCurrentOffsetA: single, Min=-10, Max=10, Unit="A"  % Ts=calibration; Class=TunableCalibration; Phase-A ADC current offset
  PhaseCurrentOffsetB: single, Min=-10, Max=10, Unit="A"  % Ts=calibration; Class=TunableCalibration; Phase-B ADC current offset
  AlignmentVd: single, Min=-1000, Max=1000, Unit="V"  % Ts=calibration; Class=TunableCalibration; Alignment d-axis voltage
  AlignmentVq: single, Min=-1000, Max=1000, Unit="V"  % Ts=calibration; Class=TunableCalibration; Alignment q-axis voltage
  AlignmentDurationTicks: uint16, Min=1, Max=65535, Unit="1"  % Ts=calibration; Class=TunableCalibration; Alignment duration in supervisor ticks
  SampleCount: uint16, Min=1, Max=65535, Unit="1"  % Ts=calibration; Class=TunableCalibration; Offset-calibration sample count
  ParameterSetVersion: uint16, Min=0, Max=65535, Unit="1"  % Ts=calibration; Class=TunableCalibration; Encoded parameter-set version
  ParameterSetCrc: uint32, Min=0, Max=4294967295, Unit="1"  % Ts=calibration; Class=TunableCalibration; CRC32 placeholder for exported calibration set

PMSM_FOC_Parameter_Catalog = [struct(
  Name="FOC_Native_CurrentIntegratorLimit",
  Default=30,
  DataType="single",
  Unit="A",
  Minimum=0,
  Maximum=100,
  Owner="Control",
  Version="2.1.0",
  DataClass="TunableCalibration",
  Description="D/q PI integrator absolute limit"), struct(
  Name="FOC_Native_CurrentPeriod",
  Default=0.0001,
  DataType="single",
  Unit="s",
  Minimum=1.0e-6,
  Maximum=0.01,
  Owner="Scheduler",
  Version="2.1.0",
  DataClass="CompileTimeConstant",
  Description="Current-control task period"), struct(
  Name="FOC_Native_DutyMax",
  Default=0.98,
  DataType="single",
  Unit="1",
  Minimum=0,
  Maximum=1,
  Owner="Modulation",
  Version="2.1.0",
  DataClass="TunableCalibration",
  Description="Maximum SVPWM duty"), struct(
  Name="FOC_Native_DutyMin",
  Default=0.02,
  DataType="single",
  Unit="1",
  Minimum=0,
  Maximum=1,
  Owner="Modulation",
  Version="2.1.0",
  DataClass="TunableCalibration",
  Description="Minimum SVPWM duty"), struct(
  Name="FOC_Native_FluxPM",
  Default=0.05,
  DataType="single",
  Unit="Wb",
  Minimum=0,
  Maximum=1,
  Owner="MotorCalibration",
  Version="2.1.0",
  DataClass="TunableCalibration",
  Description="Permanent-magnet flux linkage"), struct(
  Name="FOC_Native_IqLimit",
  Default=8,
  DataType="single",
  Unit="A",
  Minimum=0,
  Maximum=40,
  Owner="Control",
  Version="2.1.0",
  DataClass="TunableCalibration",
  Description="Speed-loop q-axis current command limit"), struct(
  Name="FOC_Native_KiCurrent",
  Default=500,
  DataType="single",
  Unit="V/(A*s)",
  Minimum=0,
  Maximum=100000,
  Owner="Control",
  Version="2.1.0",
  DataClass="TunableCalibration",
  Description="Current PI integral gain"), struct(
  Name="FOC_Native_KiSpeed",
  Default=0.05,
  DataType="single",
  Unit="A/(rad)",
  Minimum=0,
  Maximum=100,
  Owner="Control",
  Version="2.1.0",
  DataClass="TunableCalibration",
  Description="Speed PI integral gain"), struct(
  Name="FOC_Native_KpCurrent",
  Default=1,
  DataType="single",
  Unit="V/A",
  Minimum=0,
  Maximum=1000,
  Owner="Control",
  Version="2.1.0",
  DataClass="TunableCalibration",
  Description="Current PI proportional gain"), struct(
  Name="FOC_Native_KpSpeed",
  Default=0.02,
  DataType="single",
  Unit="A/(rad/s)",
  Minimum=0,
  Maximum=100,
  Owner="Control",
  Version="2.1.0",
  DataClass="TunableCalibration",
  Description="Speed PI proportional gain"), struct(
  Name="FOC_Native_Ld",
  Default=0.001,
  DataType="single",
  Unit="H",
  Minimum=1.0e-6,
  Maximum=1,
  Owner="MotorCalibration",
  Version="2.1.0",
  DataClass="TunableCalibration",
  Description="D-axis inductance"), struct(
  Name="FOC_Native_Lq",
  Default=0.001,
  DataType="single",
  Unit="H",
  Minimum=1.0e-6,
  Maximum=1,
  Owner="MotorCalibration",
  Version="2.1.0",
  DataClass="TunableCalibration",
  Description="Q-axis inductance"), struct(
  Name="FOC_Native_PolePairs",
  Default=4,
  DataType="single",
  Unit="1",
  Minimum=1,
  Maximum=64,
  Owner="MotorCalibration",
  Version="2.1.0",
  DataClass="TunableCalibration",
  Description="Integer-valued motor pole-pair count stored as single for plant equation compatibility"), struct(
  Name="FOC_Native_SpeedPeriod",
  Default=0.001,
  DataType="single",
  Unit="s",
  Minimum=1.0e-5,
  Maximum=0.1,
  Owner="Scheduler",
  Version="2.1.0",
  DataClass="CompileTimeConstant",
  Description="Speed-control task period"), struct(
  Name="FOC_Native_VoltageLimit",
  Default=26,
  DataType="single",
  Unit="V",
  Minimum=0,
  Maximum=1000,
  Owner="Control",
  Version="2.1.0",
  DataClass="TunableCalibration",
  Description="Independent d/q voltage command limit"), struct(
  Name="NATIVE_INV_SQRT3",
  Default=0.5773503,
  DataType="single",
  Unit="1",
  Minimum=0,
  Maximum=1,
  Owner="MathLibrary",
  Version="2.1.0",
  DataClass="CompileTimeConstant",
  Description="Inverse square root of three"), struct(
  Name="NATIVE_RPM_TO_RAD_S",
  Default=0.1047198,
  DataType="single",
  Unit="rad/s/rpm",
  Minimum=0,
  Maximum=1,
  Owner="MathLibrary",
  Version="2.1.0",
  DataClass="CompileTimeConstant",
  Description="RPM to radians-per-second conversion"), struct(
  Name="NATIVE_SQRT3_BY2",
  Default=0.8660254,
  DataType="single",
  Unit="1",
  Minimum=0,
  Maximum=1,
  Owner="MathLibrary",
  Version="2.1.0",
  DataClass="CompileTimeConstant",
  Description="Square root of three divided by two"), struct(
  Name="PMSM_Protection_MaxCurrent_A",
  Default=12,
  DataType="single",
  Unit="A",
  Minimum=0,
  Maximum=40,
  Owner="Safety",
  Version="2.1.0",
  DataClass="TunableCalibration",
  Description="Fast overcurrent trip threshold"), struct(
  Name="PMSM_Protection_MaxSpeed_Rpm",
  Default=3000,
  DataType="single",
  Unit="rpm",
  Minimum=0,
  Maximum=12000,
  Owner="Safety",
  Version="2.1.0",
  DataClass="TunableCalibration",
  Description="Slow overspeed trip threshold"), struct(
  Name="PMSM_Protection_MinDcBus_V",
  Default=10,
  DataType="single",
  Unit="V",
  Minimum=0,
  Maximum=1000,
  Owner="Safety",
  Version="2.1.0",
  DataClass="TunableCalibration",
  Description="DC-bus undervoltage threshold"), struct(
  Name="PMSM_Protection_MaxDcBus_V",
  Default=60,
  DataType="single",
  Unit="V",
  Minimum=0,
  Maximum=1000,
  Owner="Safety",
  Version="2.1.0",
  DataClass="TunableCalibration",
  Description="DC-bus overvoltage threshold"), struct(
  Name="PMSM_Calibration_SampleCount",
  Default=100,
  DataType="uint16",
  Unit="tick",
  Minimum=1,
  Maximum=65535,
  Owner="Measurement",
  Version="2.1.0",
  DataClass="TunableCalibration",
  Description="Current-offset averaging sample count"), struct(
  Name="PMSM_Calibration_TimeoutTicks",
  Default=15,
  DataType="uint16",
  Unit="tick",
  Minimum=1,
  Maximum=65535,
  Owner="StateManager",
  Version="2.1.0",
  DataClass="TunableCalibration",
  Description="Calibration timeout in 1 ms supervisor ticks"), struct(
  Name="PMSM_Alignment_Vd_V",
  Default=2,
  DataType="single",
  Unit="V",
  Minimum=-1000,
  Maximum=1000,
  Owner="Control",
  Version="2.1.0",
  DataClass="TunableCalibration",
  Description="Alignment d-axis voltage"), struct(
  Name="PMSM_Alignment_Vq_V",
  Default=0,
  DataType="single",
  Unit="V",
  Minimum=-1000,
  Maximum=1000,
  Owner="Control",
  Version="2.1.0",
  DataClass="TunableCalibration",
  Description="Alignment q-axis voltage"), struct(
  Name="PMSM_Alignment_Sin",
  Default=0,
  DataType="single",
  Unit="1",
  Minimum=-1,
  Maximum=1,
  Owner="Control",
  Version="2.1.0",
  DataClass="CompileTimeConstant",
  Description="Alignment electrical-angle sine"), struct(
  Name="PMSM_Alignment_Cos",
  Default=1,
  DataType="single",
  Unit="1",
  Minimum=-1,
  Maximum=1,
  Owner="Control",
  Version="2.1.0",
  DataClass="CompileTimeConstant",
  Description="Alignment electrical-angle cosine"), struct(
  Name="PMSM_Alignment_DurationTicks",
  Default=20,
  DataType="uint16",
  Unit="tick",
  Minimum=1,
  Maximum=65535,
  Owner="StateManager",
  Version="2.1.0",
  DataClass="TunableCalibration",
  Description="Alignment duration in 1 ms supervisor ticks"), struct(
  Name="PMSM_SafeDuty",
  Default=0.5,
  DataType="single",
  Unit="1",
  Minimum=0,
  Maximum=1,
  Owner="Safety",
  Version="2.1.0",
  DataClass="CompileTimeConstant",
  Description="Duty applied while PWM is inhibited")]

PMSM_FOC_Interface_Catalog = [struct(
  BusName="ControlCommandBus",
  ElementName="StartRequest",
  DataType="boolean",
  Unit="1",
  Minimum=0,
  Maximum=1,
  SampleTime="1 ms",
  DataClass="RuntimeSignal",
  Description="Level request sampled by the 1 ms command arbiter; hold for at least one slow tick"), struct(
  BusName="ControlCommandBus",
  ElementName="StopRequest",
  DataType="boolean",
  Unit="1",
  Minimum=0,
  Maximum=1,
  SampleTime="1 ms",
  DataClass="RuntimeSignal",
  Description="Stop level; has priority over StartRequest and must be asserted for at least one slow tick"), struct(
  BusName="ControlCommandBus",
  ElementName="EmergencyStop",
  DataType="boolean",
  Unit="1",
  Minimum=0,
  Maximum=1,
  SampleTime="100 us",
  DataClass="RuntimeSignal",
  Description="Fast emergency-stop level; directly latches fault bit 0 and inhibits PWM"), struct(
  BusName="ControlCommandBus",
  ElementName="DriverFault",
  DataType="boolean",
  Unit="1",
  Minimum=0,
  Maximum=1,
  SampleTime="100 us",
  DataClass="RuntimeSignal",
  Description="Fast gate-driver fault level; directly latches fault bit 1 and inhibits PWM"), struct(
  BusName="ControlCommandBus",
  ElementName="HardwareGate",
  DataType="boolean",
  Unit="1",
  Minimum=0,
  Maximum=1,
  SampleTime="100 us",
  DataClass="RuntimeSignal",
  Description="External hardware permission; false independently inhibits final PWM without software substitution"), struct(
  BusName="ControlCommandBus",
  ElementName="Direction",
  DataType="int8",
  Unit="1",
  Minimum=-1,
  Maximum=1,
  SampleTime="1 ms",
  DataClass="RuntimeSignal",
  Description="Requested direction: -1, 0 or +1"), struct(
  BusName="ControlCommandBus",
  ElementName="SpeedReferenceRpm",
  DataType="single",
  Unit="rpm",
  Minimum=-6000,
  Maximum=6000,
  SampleTime="1 ms",
  DataClass="RuntimeSignal",
  Description="Mechanical speed reference"), struct(
  BusName="ControlCommandBus",
  ElementName="TorqueReferenceNm",
  DataType="single",
  Unit="N*m",
  Minimum=-20,
  Maximum=20,
  SampleTime="1 ms",
  DataClass="RuntimeSignal",
  Description="Torque reference reserved for torque mode"), struct(
  BusName="ControlCommandBus",
  ElementName="FaultResetRequest",
  DataType="boolean",
  Unit="1",
  Minimum=0,
  Maximum=1,
  SampleTime="1 ms",
  DataClass="RuntimeSignal",
  Description="Reset level accepted only while stopped, start is clear, raw faults are clear, and HardwareGate is true"), struct(
  BusName="MeasurementBus",
  ElementName="PhaseCurrentA",
  DataType="single",
  Unit="A",
  Minimum=-40,
  Maximum=40,
  SampleTime="100 us",
  DataClass="RuntimeSignal",
  Description="Measured phase-A current"), struct(
  BusName="MeasurementBus",
  ElementName="PhaseCurrentB",
  DataType="single",
  Unit="A",
  Minimum=-40,
  Maximum=40,
  SampleTime="100 us",
  DataClass="RuntimeSignal",
  Description="Measured phase-B current"), struct(
  BusName="MeasurementBus",
  ElementName="PhaseCurrentC",
  DataType="single",
  Unit="A",
  Minimum=-40,
  Maximum=40,
  SampleTime="100 us",
  DataClass="RuntimeSignal",
  Description="Measured phase-C current; reserved for plausibility checks"), struct(
  BusName="MeasurementBus",
  ElementName="DcBusVoltage",
  DataType="single",
  Unit="V",
  Minimum=0,
  Maximum=1000,
  SampleTime="100 us",
  DataClass="RuntimeSignal",
  Description="Measured DC-bus voltage"), struct(
  BusName="MeasurementBus",
  ElementName="ElectricalAngleRad",
  DataType="single",
  Unit="rad",
  Minimum=-6.2831855,
  Maximum=6.2831855,
  SampleTime="100 us",
  DataClass="RuntimeSignal",
  Description="Electrical rotor angle"), struct(
  BusName="MeasurementBus",
  ElementName="MechanicalSpeedRpm",
  DataType="single",
  Unit="rpm",
  Minimum=-12000,
  Maximum=12000,
  SampleTime="1 ms",
  DataClass="RuntimeSignal",
  Description="Mechanical rotor speed"), struct(
  BusName="MeasurementBus",
  ElementName="Valid",
  DataType="boolean",
  Unit="1",
  Minimum=0,
  Maximum=1,
  SampleTime="100 us",
  DataClass="RuntimeSignal",
  Description="Aggregate measurement validity"), struct(
  BusName="MeasurementBus",
  ElementName="TimestampSeconds",
  DataType="single",
  Unit="s",
  Minimum=0,
  Maximum=1000000000,
  SampleTime="100 us",
  DataClass="RuntimeSignal",
  Description="Acquisition timestamp"), struct(
  BusName="MeasurementBus",
  ElementName="FreshnessTicks",
  DataType="uint16",
  Unit="tick",
  Minimum=0,
  Maximum=65535,
  SampleTime="100 us",
  DataClass="RuntimeSignal",
  Description="Age since latest valid acquisition"), struct(
  BusName="ControlStatusBus",
  ElementName="DutyA",
  DataType="single",
  Unit="1",
  Minimum=0,
  Maximum=1,
  SampleTime="100 us",
  DataClass="ReadOnlyDiagnostic",
  Description="Raw SVPWM phase-A duty request; actuator must also honor PwmEnable"), struct(
  BusName="ControlStatusBus",
  ElementName="DutyB",
  DataType="single",
  Unit="1",
  Minimum=0,
  Maximum=1,
  SampleTime="100 us",
  DataClass="ReadOnlyDiagnostic",
  Description="Raw SVPWM phase-B duty request; actuator must also honor PwmEnable"), struct(
  BusName="ControlStatusBus",
  ElementName="DutyC",
  DataType="single",
  Unit="1",
  Minimum=0,
  Maximum=1,
  SampleTime="100 us",
  DataClass="ReadOnlyDiagnostic",
  Description="Raw SVPWM phase-C duty request; actuator must also honor PwmEnable"), struct(
  BusName="ControlStatusBus",
  ElementName="IqReference",
  DataType="single",
  Unit="A",
  Minimum=-40,
  Maximum=40,
  SampleTime="1 ms",
  DataClass="ReadOnlyDiagnostic",
  Description="Q-axis current reference"), struct(
  BusName="ControlStatusBus",
  ElementName="IdMeasured",
  DataType="single",
  Unit="A",
  Minimum=-40,
  Maximum=40,
  SampleTime="100 us",
  DataClass="ReadOnlyDiagnostic",
  Description="Measured d-axis current"), struct(
  BusName="ControlStatusBus",
  ElementName="IqMeasured",
  DataType="single",
  Unit="A",
  Minimum=-40,
  Maximum=40,
  SampleTime="100 us",
  DataClass="ReadOnlyDiagnostic",
  Description="Measured q-axis current"), struct(
  BusName="ControlStatusBus",
  ElementName="VdCommand",
  DataType="single",
  Unit="V",
  Minimum=-1000,
  Maximum=1000,
  SampleTime="100 us",
  DataClass="ReadOnlyDiagnostic",
  Description="Applied d-axis voltage command"), struct(
  BusName="ControlStatusBus",
  ElementName="VqCommand",
  DataType="single",
  Unit="V",
  Minimum=-1000,
  Maximum=1000,
  SampleTime="100 us",
  DataClass="ReadOnlyDiagnostic",
  Description="Applied q-axis voltage command"), struct(
  BusName="ControlStatusBus",
  ElementName="PwmEnable",
  DataType="boolean",
  Unit="1",
  Minimum=0,
  Maximum=1,
  SampleTime="100 us",
  DataClass="ReadOnlyDiagnostic",
  Description="Single final permission: SupervisorPwmRequest AND FastInterlock AND HardwareGate"), struct(
  BusName="ControlStatusBus",
  ElementName="MotorStateCode",
  DataType="uint8",
  Unit="1",
  Minimum=0,
  Maximum=255,
  SampleTime="1 ms",
  DataClass="ReadOnlyDiagnostic",
  Description="Supervisor state code"), struct(
  BusName="ControlStatusBus",
  ElementName="FaultBits",
  DataType="uint32",
  Unit="1",
  Minimum=0,
  Maximum=4294967295,
  SampleTime="100 us",
  DataClass="ReadOnlyDiagnostic",
  Description="Latched fault bitmap: bits 0..6 = EStop, driver, overcurrent, invalid measurement, overspeed, undervoltage, overvoltage"), struct(
  BusName="ControlStatusBus",
  ElementName="FaultCode",
  DataType="uint16",
  Unit="1",
  Minimum=0,
  Maximum=65535,
  SampleTime="100 us",
  DataClass="ReadOnlyDiagnostic",
  Description="Primary latched fault code 1..7 in bitmap priority order; zero means no fault"), struct(
  BusName="ControlStatusBus",
  ElementName="CurrentLimitActive",
  DataType="boolean",
  Unit="1",
  Minimum=0,
  Maximum=1,
  SampleTime="100 us",
  DataClass="ReadOnlyDiagnostic",
  Description="Latched software-overcurrent status (fault bit 2)"), struct(
  BusName="ControlStatusBus",
  ElementName="VoltageLimitActive",
  DataType="boolean",
  Unit="1",
  Minimum=0,
  Maximum=1,
  SampleTime="100 us",
  DataClass="ReadOnlyDiagnostic",
  Description="Voltage saturation status; detailed detection belongs to CTL-001"), struct(
  BusName="ControlStatusBus",
  ElementName="MeasurementValid",
  DataType="boolean",
  Unit="1",
  Minimum=0,
  Maximum=1,
  SampleTime="100 us",
  DataClass="ReadOnlyDiagnostic",
  Description="Echo of aggregate measurement validity"), struct(
  BusName="CalibrationBus",
  ElementName="PhaseCurrentOffsetA",
  DataType="single",
  Unit="A",
  Minimum=-10,
  Maximum=10,
  SampleTime="calibration",
  DataClass="TunableCalibration",
  Description="Phase-A ADC current offset"), struct(
  BusName="CalibrationBus",
  ElementName="PhaseCurrentOffsetB",
  DataType="single",
  Unit="A",
  Minimum=-10,
  Maximum=10,
  SampleTime="calibration",
  DataClass="TunableCalibration",
  Description="Phase-B ADC current offset"), struct(
  BusName="CalibrationBus",
  ElementName="AlignmentVd",
  DataType="single",
  Unit="V",
  Minimum=-1000,
  Maximum=1000,
  SampleTime="calibration",
  DataClass="TunableCalibration",
  Description="Alignment d-axis voltage"), struct(
  BusName="CalibrationBus",
  ElementName="AlignmentVq",
  DataType="single",
  Unit="V",
  Minimum=-1000,
  Maximum=1000,
  SampleTime="calibration",
  DataClass="TunableCalibration",
  Description="Alignment q-axis voltage"), struct(
  BusName="CalibrationBus",
  ElementName="AlignmentDurationTicks",
  DataType="uint16",
  Unit="tick",
  Minimum=1,
  Maximum=65535,
  SampleTime="calibration",
  DataClass="TunableCalibration",
  Description="Alignment duration in supervisor ticks"), struct(
  BusName="CalibrationBus",
  ElementName="SampleCount",
  DataType="uint16",
  Unit="tick",
  Minimum=1,
  Maximum=65535,
  SampleTime="calibration",
  DataClass="TunableCalibration",
  Description="Offset-calibration sample count"), struct(
  BusName="CalibrationBus",
  ElementName="ParameterSetVersion",
  DataType="uint16",
  Unit="1",
  Minimum=0,
  Maximum=65535,
  SampleTime="calibration",
  DataClass="TunableCalibration",
  Description="Encoded parameter-set version")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]

PMSM_FOC_Data_Class_Catalog = struct(
  CompileTimeConstant="Inlined algorithm/math invariant",
  TunableCalibration="Exported calibration/protection parameter",
  RuntimeSignal="Bus element exchanged at run time",
  ReadOnlyDiagnostic="Controller status written by the controller")

PMSM_FOC_Calibration_Defaults = struct(
  PhaseCurrentOffsetA=single(0),
  PhaseCurrentOffsetB=single(0),
  AlignmentVd=single(2),
  AlignmentVq=single(0),
  AlignmentDurationTicks=uint16(20),
  SampleCount=uint16(100),
  ParameterSetVersion=uint16(210),
  ParameterSetCrc=uint32(0))

PMSM_FOC_Parameter_Set_Version = "2.1.0"
PMSM_FOC_Compatibility_Id = "PMSM_FOC_DUALPLANT_V21"
PMSM_FOC_Parameter_Set_CRC32 = "TBD_BY_CALIBRATION_EXPORT_PIPELINE"