% Simulink data dictionary sim1.sldd

xin = Simulink.Signal(StorageClass="ImportedExtern")
yout = Simulink.Signal(StorageClass="ExportedGlobal")
y = Simulink.Signal(StorageClass="ImportedExtern")
z = Simulink.Signal(StorageClass="ExportedGlobal")
x = Simulink.Signal(StorageClass="ImportedExtern", Alias="x")
kgain = Simulink.Parameter(5, StorageClass="ConstVolatile")